vi "AMCoherent.gvi"   [LabVIEW NXG 3.1.0]
inputs:
  "AM Signal": waveform<f64> = {dt=1, Y=[]}
  "order": i32 = 2
  "cutoff frequency": f64 = 0.125
  "Carrier Signal": waveform<f64> = {dt=1, Y=[]}
outputs:
  "demodulated signal in time": waveform<f64>
  "demodulated signal in frequency": T1
types:
  T1 = cluster{"f0": f64, "df": f64, "magnitude": f64[]}
uses:
  NI::Analysis::Filtering::Butterworth Lowpass Filter (Waveform).gvi
  NI::Analysis::Measurement::AC DC and RMS (single-shot)(Wfm).gvi
  NI::Analysis::Measurement::Power Spectral Density for 1 Chan.gvi
diagram:
  Waveform Multiply($"AM Signal", $"Carrier Signal") -> w1
  call "Butterworth Lowpass Filter (Waveform).gvi"(signal=w1, cutoff frequency=$"cutoff frequency", order=$order) -> (filtered signal=w2)
  call "AC DC and RMS (single-shot)(Wfm).gvi"(signal=w2) -> (DC value=w3)
  Waveform Subtract(x=w2, y=w3) -> w4
  $"demodulated signal in time" <- w4
  call "Power Spectral Density for 1 Chan.gvi"(signal=w4) -> (power spectral density=w5)
  $"demodulated signal in frequency" <- w5
