vi "DPSK_Tx_Rx.gvi"   [LabVIEW NXG 3.1.0]
panel controls:
  "IQ rate": f64 = 200000
  "device names": "USRP niUSRPClass"
  "carrier frequency": f64 = 400000000
  "gain Tx": f64
  "active antenna Tx": string = "TX1"
  "stop Tx": bool
  "gain Rx": f64
  "active antenna Rx": string = "RX2"
  "total bits": i32 = 128
  "M": i32 = 16
  "message length": i32
panel indicators:
  "Baseband Waveform": waveform<f64>
  "Baseband Power Spectrum_Tx": T1
  "Baseband Power Spectrum_Rx": T1
  "Baseband Waveform_2": waveform<c128>
  "BER": f64
  "trigger found?": bool
  "subarray": f64[]
types:
  T1 = cluster{"f0": f64, "df": f64, "magnitude": f64[]}
uses:
  NI::Modulation::MT Generate Filter Coefficients.gvi
  NI::Modulation::MT Generate Bits (Fibonacci, PN Order).gvi
  NI::Analysis::Resampling::Upsample (DBL).gvi
  NI::Analysis::Operations::1D Convolution (DBL).gvi
  NI::USRP::niUSRP Open Rx Session.gvi
  NI::USRP::niUSRP Configure Signal.gvi
  NI::USRP::niUSRP Initiate.gvi
  NI::USRP::niUSRP Fetch Rx Data (CDB).gvi
  NI::Analysis::Operations::1D Convolution (CDB).gvi
  NI::USRP::niUSRP Close Session.gvi
  NI::Analysis::Resampling::Decimate (single shot, CDB).gvi
  NI::Modulation::MT Calculate BER After Trigger (Fibonacci PN Sequence).gvi
  NI::USRP::niUSRP Open Tx Session.gvi
  NI::USRP::niUSRP Write Tx Data (CDB).gvi
diagram:
  call "MT Generate Filter Coefficients.gvi"(pulse shaping filter="Root Raised Cos", pulse shaping samples per symbol=20, modulation type="PSK") -> (pulse shaping filter coefficients=w1)
  call "MT Generate Bits (Fibonacci, PN Order).gvi"(total bits=$"total bits") -> (output bit stream=w2)
  Multiply(w2, 2) -> w3
  Subtract(x=w3, y=1) -> w4
  call "AddFrameHeader.gvi"(array=w4) -> (output array=w5)
  for (iteration -> i1) {
    w6 = each element of w5
    Is Equal To 0(x=i1) -> w8
    Feedback Node(input=w9) -> w10
    Multiply(w6, w10) -> w11
    Select(s=w8, t=1, f=w11) -> w9
    append w9 to w7
  }
  call "Upsample (DBL).gvi"(signal=w7, upsampling factor=20) -> (upsampled signal=w12)
  call "1D Convolution (DBL).gvi"(x=w12, y=w1) -> (x * y=w13)
  call "Quick Scale 1D.gvi"(X=w13) -> (Y[i]=X[i]/Max|X|=w14)
  # Transmitter
  Reciprocal(x=$"IQ rate") -> w15
  Build Waveform Node(Y=w14, dt=w15) -> (output waveform=w16)
  $"Baseband Waveform" <- w16
  # Receiver
  call "niUSRP Open Rx Session.gvi"(device names=$"device names") -> (session handle out=w17, error out=w18)
  call "niUSRP Configure Signal.gvi"(active antenna=$"active antenna Rx", session handle=w17, error in=w18, IQ rate=$"IQ rate", carrier frequency=$"carrier frequency", gain=$"gain Rx") -> (session handle out=w19, error out=w20, coerced carrier frequency=w21)
  Subtract(x=w21, y=20000) -> w22
  Property Node(instance in=w19, "niUSRP"=w22) -> (instance out=w23)
  call "niUSRP Initiate.gvi"(session handle=w23, error in=w20) -> (session handle out=w24, error out=w25)
  call "niUSRP Fetch Rx Data (CDB).gvi"(session handle=w24, error in=w25, number of samples=1000000) -> (session handle out=w26, error out=w27, data=w28)
  call "MT Generate Filter Coefficients.gvi"(pulse shaping filter="Root Raised Cos", matched samples per symbol=$M, modulation type="PSK") -> (matched filter coefficients=w29)
  call "1D Convolution (CDB).gvi"(x=w29, y=w28) -> (x * y=w30)
  Build Waveform Node(Y=w30, dt=w15) -> (output waveform=w31)
  $"Baseband Waveform_2" <- w31
  w32 = cluster{"t0": timestamp, "dt": f64, "Y": c128[]} {all zero or empty}
  Property Node(instance in=w32, "dt"=w15, "Y"=w30) -> (instance out=w33)
  call "FFT Power Spectrum for 1 Chan (CDB)2.gvi"(time signal=w33, dB On (F)=TRUE) -> (power spectrum=w34)
  $"Baseband Power Spectrum_Rx" <- w34
  call "niUSRP Close Session.gvi"(session handle=w26, error in=w27)
  w35 = cluster{"t0": timestamp, "dt": f64, "Y": c128[]} {all zero or empty}
  Real And Imaginary To Complex(x=w14, y=0) -> w36
  Property Node(instance in=w35, "Y"=w36, "dt"=w15) -> (instance out=w37)
  call "FFT Power Spectrum for 1 Chan (CDB)2.gvi"(time signal=w37, dB On (F)=TRUE) -> (power spectrum=w38)
  $"Baseband Power Spectrum_Tx" <- w38
  call "PulseAlign (Complex).gvi"(Input signal=w30, Receiver Sampling Factor=$M) -> (aligned output=w39)
  call "Decimate (single shot, CDB).gvi"(signal=w39, decimating factor=$M) -> (decimated signal=w40)
  for {
    w41 = each element of w40
    Feedback Node(input=w41) -> w43
    Complex Conjugate(x + iy=w43) -> w44
    Multiply(w44, w41) -> w45
    append w45 to w42
  }
  call "FrameSync (Complex).gvi"(Sampled Input=w42) -> (Aligned Samples=w46)
  Complex To Real Imaginary(x + iy=w46) -> (x=w47)
  for {
    w48 = each element of w47
    Is Greater Than 0(x=w48) -> w50
    Select(s=w50, t=1, f=0) -> w51
    append w51 to w49
  }
  Array Subset(array=w49, index0=0, length0=$"message length") -> w52
  call "MT Calculate BER After Trigger (Fibonacci PN Sequence).gvi"(input bit stream=w52, BER trigger threshold=0.4) -> (BER=w53, trigger found?=w54)
  $BER <- w53
  $"trigger found?" <- w54
  $subarray <- w52
  call "niUSRP Open Tx Session.gvi"(device names=$"device names") -> (session handle out=w55, error out=w56)
  call "niUSRP Configure Signal.gvi"(active antenna=$"active antenna Tx", session handle=w55, error in=w56, IQ rate=$"IQ rate", carrier frequency=$"carrier frequency", gain=$"gain Tx") -> (session handle out=w57, error out=w58)
  while {
    call "niUSRP Write Tx Data (CDB).gvi"(session handle=w57, error in=w58, data=w36) -> (session handle out=w59, error out=w60)
    stop if $"stop Tx"
  }
  call "niUSRP Close Session.gvi"(session handle=w59, error in=w60)
